# Grasshopper definition gh_testSite_benchmark.gh (Grasshopper 1.0.7)
# plug-ins: TableUI, Firefly.X

udp_listener = UDPListener(Port="5005")
panel = Panel(udp_listener)
parse = ParseJson(JSON=panel)  # -> IDs, Position, Rotation
panel_2 = Panel(parse.IDs)
panel_3 = Panel(parse.Position)
panel_4 = Panel(parse.Rotation)
firebase_text = Curve([<curve referenced from the Rhino model> x13])
udp_text = Curve([<curve referenced from the Rhino model> x5])
pt = Point(panel_3)
move = Move(Geometry=udp_text, Motion=pt)  # -> Geometry, Transform

# ---- group: Get JSON data from Firebase database
panel_5 = Panel("https://magpietable-default-rtdb.firebaseio.com/.json")
trigger = Trigger(Interval=5, TimerInterval=5, Target=[http_get, udp_listener])
toggle = BooleanToggle(True)

# ----
http_get = HttpGetAsync(URL=panel_5, Send=toggle, Expire=1000)

# ---- group: Get JSON data from Firebase database (continued)
panel_6 = Panel(http_get)

# ----
parse_2 = ParseJson(JSON=http_get)  # -> IDs, Position, Rotation
panel_7 = Panel(parse_2.IDs)
panel_8 = Panel(parse_2.Position)
panel_9 = Panel(parse_2.Rotation)
pt_2 = Point(panel_8)
move_2 = Move(Geometry=firebase_text, Motion=pt_2)  # -> Geometry, Transform
