# Grasshopper definition gh_testSite_decoupling.gh (Grasshopper 1.0.7)
# plug-ins: TableUiAdapter

panel = Panel("5005")
trigger = Trigger(Interval=50, TimerInterval=50, Target=tableui)  # disabled
tableui = TableUiAdapterComponent(Link=Toggle(True))  # -> Points, Ids, Rotation, Types
c_script = CSharpScript(incomingData=tableui.Points)  # -> out, outgoingData
# ---------- c_script: C# ----------
    if (incomingData != null) {
      outgoingData = incomingData;
      savedData = incomingData;
    }
    else
    {
      outgoingData = savedData;
    }
# ---------- c_script: C# additional code ----------
  private object savedData;
# ---------- end c_script ----------
brep = Brep(<brep referenced from the Rhino model>)
panel_2 = Panel(tableui.Types)
move = Move(Geometry=brep, Motion=tableui.Points)  # -> Geometry, Transform
rotate = Rotate(Geometry=move.Geometry, Angle=tableui.Rotation, Plane=tableui.Points)  # -> Geometry, Transform
panel_3 = Panel(c_script.outgoingData)
